# Grasshopper definition SimpleGrasshopperEnv.gh (Grasshopper 1.0.7)

path = FilePath("C:\Users\jackm\Documents\Stuttgart\Stuttgart_23-24\Studio\RL_REPO\CampusLab_RL\PPO\post\request.txt")
file = ReadFile(File=path, PerLineParse=True)
item = ListItem(List=file, Index=0, Wrap=True)  # -> Item, Item1, Item2, Item3, Item4
num = Number(file)
python = GhPythonScript(T_min=item.Item, T_max=item.Item1, T_outside=item.Item2, T_inside=item.Item3, action=item.Item4)  # -> T_inside, reward; inputs action: Int32
# ---------- python: Python ----------
__author__ = "jackm"
__version__ = "2024.02.13"


# Apply action: 0-close window, 1-open window

# if window open air exchange is fast, otherwise slow
if action == 1:
    ach = 0.1
else:
    ach = 0.001
    
# Temp Difference
dT = T_outside - T_inside

T_inside += ach*dT

# Rewards
reward = 0

if T_min < T_inside and T_inside < T_max:
    reward += 3 #big reward for comfort zone

if T_inside < T_min:
    if dT >= 0:
        #small reward for warming if too cold
        reward += 1 
    else:
        #punish for cooling if too cold
        reward -= abs(T_min - T_inside) 
if T_inside > T_max:
    if  dT <= 0:
        #small reward for cooling if too hot
        reward += 1 
    else:
        #punish for heating if too hot
        reward -= abs(T_max - T_inside)
# ---------- end python ----------
merge = Merge(Data1=flatten(python.reward), Data2=flatten(num))  # -> simplify(graft(Result))
merge_2 = Merge(Data1=python.T_inside, Data2=python.reward)
rec = DataRecorder(merge, DataLimit=-10, RecordData=True)
reply = GhPythonScript(txt=merge_2, path=path)  # inputs txt: list
# ---------- reply: Python ----------
__author__ = "jackm"
__version__ = "2024.02.13"

path = path.rsplit('\\',1)[0] + "\\reply.txt"

if(txt is not None):
    with open(path, 'w') as file:
        text = ""
        for t in txt:
            text+= str(t) + "\n"
        file.write(text)
        file.close()
# ---------- end reply ----------
bang = ExplodeTree(Data=rec)  # -> Branch0, Branch1, Branch2, Branch3, Branch4, Branch5, Branch6
entwine = Entwine(Branch00=bang.Branch1, Branch01=bang.Branch2, Branch02=bang.Branch3, Branch03=bang.Branch4, FlattenInputs=True)
num_2 = Number(python.reward)

# ----
# Rewards
reward = QuickGraph(bang.Branch0, SortOrder=0)

# ----
# Temperatures
reward_2 = QuickGraph(entwine, SortOrder=0)

# ----
# Action
reward_3 = QuickGraph(bang.Branch5, SortOrder=0)

reward_4 = Panel(num_2)
