# Grasshopper definition Simulation_GrasshopperEnv.gh (Grasshopper 1.0.7)

path = FilePath("E:\ITECH\23W\Studio\CampusLab_RL\PPO\post\request.txt")
python = GhPythonScript(x=path)  # -> a
# ---------- python: Python ----------
__author__ = "Medion Erazer"
__version__ = "2024.02.18"


with open(x , 'r') as file:
    a = file.readlines()
    file.close()
# ---------- end python ----------
panel = Panel(python)
item = ListItem(List=python, Index=0, Wrap=True)  # -> Item, Item1, Item2, Item3, Item4
python_2 = GhPythonScript(x=item.Item1)  # -> a; inputs x: Int32
# ---------- python_2: Python ----------
__author__ = "Medion Erazer"
__version__ = "2024.02.18"

import rhinoscriptsyntax as rs

if x == 0:
    a = False
else:
    a = True
# ---------- end python_2 ----------
python_3 = GhPythonScript(x=item.Item4)  # -> a
# ---------- python_3: Python ----------
__author__ = "Medion Erazer"
__version__ = "2024.02.18"

import rhinoscriptsyntax as rs

if x<24:
    a =x
else:
    a = 0
# ---------- end python_3 ----------
num = Number(item.Item1)

# ----
# Create Honeybee Room
panel_2 = Panel("2.4")
Z = UnitZ(Factor=panel_2)
geo = Geometry(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)
extr = Extrude(Base=geo, Direction=Z)
geo_2 = Geometry(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)
geo_3 = Geometry([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])
door = HBDoor(geo=geo_2, name="Front Door")  # -> report, doors; plug-in component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
aperture = HBAperture(geo=geo_3, operable=python_2)  # -> report, apertures; plug-in component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
face = HBFace(geo=extr, name="Pavillion face")  # -> report, faces; plug-in component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
panel_3 = Panel("2004::ClimateZone3::SteelFramed")
addsubface = HBAddSubface(hb_obj=flatten(face.faces), sub_faces=flatten([aperture.apertures, door.doors]))  # -> hb_obj; plug-in component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
ventcontrol = HBVentilationControl(min_in_temp=-10, max_in_temp=40, min_out_temp=-10, max_out_temp=40)  # -> vent_cntrl; plug-in component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
room = HBRoom(faces=flatten(addsubface), name="CampusLab", conditioned=True)  # -> report, room; plug-in component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
windowopen = HBWindowOpening(rooms=flatten(room.room), vent_cntrl=ventcontrol)  # -> report, rooms; plug-in component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

toggle = BooleanToggle(False)
panel_4 = Panel("2019::LargeOffice::OpenOffice")

number_slider = Slider(1, range=0..1)
simoutput = HBSimulationOutput(comfort_metrics=Toggle(True))  # -> report, sim_output; plug-in component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
analysisperiod = LBAnalysisPeriod(
    start_month=item.Item2,
    start_day=item.Item3,
    start_hour=python_3,
    end_month=item.Item2,
    end_day=item.Item3,
    end_hour=python_3,
    timestep=number_slider)  # -> period, hoys, dates; plug-in component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
simpar = HBSimulationParameter(output=simoutput.sim_output, run_period=analysisperiod.period, timestep=number_slider)  # -> sim_par; plug-in component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

# ----
# Download EPW File
panel_5 = Panel("E:\ITECH\23W\Studio\CampusLab_RL\epw\DEU_BW_Stuttgart-Schnarrenberg.107390_TMYx.epw")
path_2 = FilePath(panel_5)

panel_6 = Panel(analysisperiod.period)
model = HBModel(rooms=flatten(windowopen.rooms))  # -> report, model; plug-in component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
importepw = LBImportEPW(epw_file=path_2)  # -> location, dry_bulb_temperature, dew_point_temperature, relative_humidity, wind_speed, wind_direction, direct_normal_rad, diffuse_horizontal_rad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; plug-in component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
vizbytype = HBVisualizeByType(hb_objs=room.room)  # -> walls, interior_walls, roofs, ceilings, exterior_floors, interior_floors, air_walls, apertures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; plug-in component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

# ---- group: Run Me!
toggle_2 = BooleanToggle(True)

# ----
modeltoosm = HBModelToOSM(model=model.model, epw_file=path_2, sim_par=simpar, write=toggle_2, run=toggle_2)  # -> report, jsons, osw, osm, idf, sql, zsz, rdd, html; plug-in component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
applyper = LBApplyAnalysisPeriod(data=importepw.dew_point_temperature, period=analysisperiod.period)  # -> data; plug-in component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
roomcomfortresult = HBReadRoomComfortResult(sql=modeltoosm.sql)  # -> oper_temp, air_temp, rad_temp, rel_humidity, unmet_heat, unmet_cool; plug-in component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
xdata = LBDeconstructData(data=applyper)  # -> header, values; plug-in component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
panel_7 = Panel(xdata.values)
xdata_2 = LBDeconstructData(data=roomcomfortresult.air_temp)  # -> header, values; plug-in component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

hourlyplot = LBHourlyPlot(data=flatten(roomcomfortresult.air_temp), base_pt="40, 300, 0")  # -> report, mesh, legend, borders, labels, title, vis_set; plug-in component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

item_2 = ListItem(List=xdata_2.values, Index=python_3, Wrap=True)
panel_8 = Panel(item_2)
python_4 = GhPythonScript(T_min="18", T_max="25", T_outside=xdata.values, T_inside=item.Item, T_simulation=item_2, action=item.Item1)  # -> reward; inputs action: Int32
# ---------- python_4: Python ----------
__author__ = "jackm"
__version__ = "2024.02.13"


# Apply action: 0-close window, 1-open window
dT = T_simulation - T_inside

# Rewards
reward = 0

if T_min < T_inside and T_inside < T_max:
    reward += 3 #big reward for comfort zone

if T_inside < T_min:
    if dT >= 0:
        #small reward for warming if too cold
        reward += 1 
    else:
        #punish for cooling if too cold
        reward -= abs(T_min - T_inside)
if T_inside > T_max:
    if  dT <= 0:
        #small reward for cooling if too hot
        reward += 1 
    else:
        #punish for heating if too hot
        reward -= abs(T_max - T_inside)
# ---------- end python_4 ----------
merge = Merge(Data1=item_2, Data2=python_4)
panel_9 = Panel(merge)
reply = GhPythonScript(txt=merge, path=path)  # inputs txt: list
# ---------- reply: Python ----------
__author__ = "jackm"
__version__ = "2024.02.13"

path = path.rsplit('\\',1)[0] + "\\reply.txt"

if(txt is not None):
    with open(path, 'w') as file:
        text = ""
        for t in txt:
            text+= str(t) + "\n"
        file.write(text)
        file.close()
# ---------- end reply ----------
merge_2 = Merge(Data1=flatten(["18", "25", xdata.values]), Data2=flatten(merge), Data3=flatten(num))  # -> simplify(graft(Result))
rec = DataRecorder(merge_2, DataLimit=-10, RecordData=True)
bang = ExplodeTree(Data=rec)  # -> Branch0, Branch1, Branch2, Branch3, Branch4, Branch5
num_2 = Number(python_4)
reward = Panel(num_2)
entwine = Entwine(Branch00=bang.Branch0, Branch01=bang.Branch1, Branch02=bang.Branch2, Branch03=bang.Branch3, FlattenInputs=True)
panel_10 = Panel(merge_2)

# ----
# Temperatures
reward_2 = QuickGraph(entwine, SortOrder=0)

# ----
# Rewards
reward_3 = QuickGraph(bang.Branch4, SortOrder=0)

# ----
# Action
reward_4 = QuickGraph(bang.Branch5, SortOrder=0)
