# Grasshopper definition ladybug_thermal_comfort.gh (Grasshopper 1.0.7)

# ---- group: Chage Glazing Ratio, Orientation, and Program
number_slider = Slider(0.3, range=0.1..0.9)
number_slider_2 = Slider(4, range=0..8, expression="x * 45")

# ----
# Create Honeybee Room
panel = Panel("outdoors")
geo = Geometry(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)
geo_2 = Geometry([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])
face = HBFace(geo=geo, bc=panel)  # -> report, faces; plug-in component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
face_2 = HBFace(geo=geo_2, bc="adiabatic")  # -> report, faces; plug-in component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
aperturesbyratio = HBAperturesByRatio(hb_objs=flatten(face.faces), ratio=number_slider, subdivide=Toggle(False))  # -> report, hb_objs; plug-in component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
room = HBRoom(
    faces=flatten([face_2.faces, aperturesbyratio.hb_objs]),
    name="Office Shoe Box",
    constr_set="2004::ClimateZone3::SteelFramed",
    program="2019::LargeOffice::OpenOffice",
    conditioned=True)  # -> report, room; plug-in component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
rotate = HBRotate(hb_objs=flatten(room.room), angle=number_slider_2)  # -> hb_objs; plug-in component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

simoutput = HBSimulationOutput(comfort_metrics=Toggle(True))  # -> report, sim_output; plug-in component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
analysisperiod = LBAnalysisPeriod(
    start_month=Slider(7, range=0..24),
    start_day=Slider(15, range=0..30),
    start_hour=Slider(8, range=0..24),
    end_month=Slider(7, range=0..24),
    end_day=Slider(15, range=0..30),
    end_hour=Slider(9, range=0..24),
    timestep=Slider(1, range=0..1))  # -> period, hoys, dates; plug-in component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
simpar = HBSimulationParameter(output=simoutput.sim_output, run_period=analysisperiod.period, timestep=6)  # -> sim_par; plug-in component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

# ----
# Download EPW File
panel_2 = Panel("E:\ITECH\23W\Studio\basic data\00_Vaihingen-20240213T181519Z-001\00_Vaihingen\00_Current\TMY_current_Vaihingen-hour.epw")
path = FilePath(panel_2)

vizbytype = HBVisualizeByType(hb_objs=rotate)  # -> walls, interior_walls, roofs, ceilings, exterior_floors, interior_floors, air_walls, apertures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; plug-in component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
model = HBModel(rooms=flatten(rotate))  # -> report, model; plug-in component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

# ---- group: Run Me!
toggle = BooleanToggle(False)

# ----
modeltoosm = HBModelToOSM(model=model.model, epw_file=path, sim_par=simpar, write=toggle, run=toggle)  # -> report, jsons, osw, osm, idf, sql, zsz, rdd, html; plug-in component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
roomcomfortresult = HBReadRoomComfortResult(sql=modeltoosm.sql)  # -> oper_temp, air_temp, rad_temp, rel_humidity, unmet_heat, unmet_cool; plug-in component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

hourlyplot = LBHourlyPlot(data=flatten(roomcomfortresult.air_temp), base_pt="40, 300, 0")  # -> report, mesh, legend, borders, labels, title, vis_set; plug-in component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

xdata = LBDeconstructData(data=roomcomfortresult.air_temp)  # -> header, values; plug-in component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
panel_3 = Panel(xdata.values)
