# Grasshopper definition test.gh (Grasshopper 1.0.7)

path = FilePath("C:\Users\jackm\Documents\Stuttgart\Stuttgart_23-24\Studio\RL_REPO\CampusLab_RL\PPO\post\request.txt")
file = ReadFile(File=path, PerLineParse=True)
num = Number(graft(file))
rec = DataRecorder(num, DataLimit=-10, RecordData=True)
item = ListItem(List=file, Index=0, Wrap=True)  # -> Item, Item1, Item2, Item3, Item4
graph = QuickGraph(rec, SortOrder=0)
python = GhPythonScript(T_min=item.Item, T_max=item.Item1, T_outside=item.Item2, T_inside=item.Item3, action=item.Item4)  # -> T_outside, T_inside, reward; inputs action: Int32
# ---------- python: Python ----------
__author__ = "jackm"
__version__ = "2024.02.13"

# Apply action: 0-close window, 1-open window
if action == 1:
    delta = T_outside - T_inside
    if delta > 0:
        T_inside += 1  # Adjust as needed
    elif delta == 0:
        T_inside += 0
    else:
        T_inside -= 1

# Rewards
reward = 0
if T_min < T_inside and T_inside < T_max:
    reward += 1
if abs(T_inside - T_min) > 5:
    reward -= 1
if abs(T_inside - T_max) > 5:
    reward -= 1
# ---------- end python ----------
merge = Merge(Data1=python.T_outside, Data2=python.T_inside, Data3=python.reward)
reward = Panel(python.reward)
reply = GhPythonScript(txt=merge, path=path)  # inputs txt: list
# ---------- reply: Python ----------
__author__ = "jackm"
__version__ = "2024.02.13"

path = path.rsplit('\\',1)[0] + "\\reply.txt"

if(txt is not None):
    with open(path, 'w') as file:
        text = ""
        for t in txt:
            text+= t + "\n"
        file.write(text)
        file.close()
# ---------- end reply ----------
